# Grasshopper definition slicer.gh (Grasshopper 1.0.7)

outer = Slider(20, range=20..40)
points = Slider(24, range=10..30)
inner = Slider(6, range=1..10)
python = GhPythonScript(inner_radius=inner, outer_radius=outer, num_points=points)  # -> curve, points
# ---------- python: Python ----------
import math
import random
import rhinoscriptsyntax as rs

points = []
for p in range(int(num_points)):
    theta = p * (2 * math.pi / num_points)
    length = inner_radius + (random.random() * (outer_radius - inner_radius))
    x = length*math.cos(theta)
    y = length*math.sin(theta)
    points.append(rs.AddPoint([x, y, 0]))

points.append(points[0])
# ---------- end python ----------
trigger = Trigger(Interval=-1000, TimerInterval=1000, Target=python_2)
vec = VectorXYZ(XComponent=0, YComponent=0, ZComponent=Slider(5, range=1..10))  # -> Vector, Length
intcrv = Interpolate(Vertices=python.points, Degree=3, Periodic=False, KnotStyle=1)  # -> Curve, Length, Domain
crv = Curve(<curve referenced from the Rhino model>)
extr = Extrude(Base=crv, Direction=vec.Vector)
pt = Point(<point referenced from the Rhino model>)
python_2 = GhPythonScript()  # -> out, file
# ---------- python_2: Python ----------
import rhinoscriptsyntax as rs

filter = "GCode (*.gcode)|*.gcode|All Files (*.*)|*.*||"
file = rs.SaveFileName("", filter)
# ---------- end python_2 ----------
geo = Geometry(<brep referenced from the Rhino model>)
crv_2 = Curve([<curve referenced from the Rhino model> x2])
cap = CapHoles(Brep=extr)
dam = DataDam(DataB=geo, DataC=pt, DataA=crv_2, BufferDelay=10000000, BufferMode=0)  # -> DataB, DataC, DataA
dam_2 = DataDam(DataA=python_2.file, BufferDelay=10000000, BufferMode=0)
geo_2 = Geometry(<brep referenced from the Rhino model>)
python_3 = GhPythonScript(filename=dam_2, shape=dam.DataB, start_point=dam.DataC, curves=dam.DataA)  # -> out, lines, turtle, print_bed, travel, vertical_path, center_points, connected_curve; inputs shape: Brep, start_point: Point3d, curves: list
# ---------- python_3: Python ----------
# code required so that library reloads appropriately
# must be above other import statements
import sys
import math
import time
import operator as op
to_delete = list()
for module in sys.modules:
    if "tree_utils" in module:
      to_delete.append(module)
    if "graph_utils" in module:
      to_delete.append(module)
    if "image_utils" in module:
      to_delete.append(module)
    if "contour_utils" in module:
      to_delete.append(module)
    if "geometry_utils" in module:
      to_delete.append(module)
    if "vertical_utils" in module:
      to_delete.append(module)
    if "slicing_utils" in module:
      to_delete.append(module)
    if "extruder_turtle" in module:
      to_delete.append(module)
    if "turtle_utilities" in module:
      to_delete.append(module)
for module in to_delete:
    sys.modules.pop(module)

import slicing_utils
from slicing_utils import *

import vertical_utils
from vertical_utils import *

import extruder_turtle
from extruder_turtle import *

import turtle_utilities as tu

import Rhino
import rhinoscriptsyntax as rs

reload(slicing_utils)
reload(extruder_turtle)


# Main code
# set up the turtle
t = ExtruderTurtle()
t.setup(filename=filename, printer = "eazao")

t.set_extrude_width(0.9)

print("standard layer height is: " +str(t.get_layer_height()))
print("standard extrusion width is: "+str(t.get_extrude_width()))

if start_point != None:
    t.pen_up()
    t.set_position(start_point.X, start_point.Y, 0)
    t.pen_down()

# draw
#travel = slice_fermat_fill(t, shape, start=6, end=9, wall_mode=True, walls=2, fill_bottom=True, bottom_layers=2)
#travel = slice_fermat_fill(t, shape, start=6, end=9)
#travel = slice_spiral_fill(t, shape, start=6, end=9)
#travel = slice_contour_fill(t, shape, start=5, end=7)
#travel, center_points = slice_vertical_and_fermat_fill(t, shape, wall_mode=True, walls=2, fill_bottom=True)

#connected_curve = connect_curves(curves, float(t.get_extrude_width())/8)
#travel = get_isocontour(connected_curve, float(t.get_extrude_width())*0.5)

travel = slice_2_half_D_fermat(t, curves, layers=1)

# visualize the turtle's path
#turtle = t.draw_turtle()
lines = t.get_lines()
print_bed = t.draw_print_bed()

# close the generated .gcode file
t.finish()
# ---------- end python_3 ----------
python_4 = GhPythonScript(path=python_3.travel, center_points=python_3.center_points, index=Slider(9, range=1..200), nozzle=geo_2)  # -> travel, new_nozzle; inputs path: list, center_points: list, index: Int32
# ---------- python_4: Python ----------
__author__ = "school"

import rhinoscriptsyntax as rs

travel = []

#for p in range(0, min(index, len(path))):
#    travel.append(path[p])

print(len(path))
for p in range(0, min(index, len(path))):
    print(path[p])
    for crv in path[p]:
        travel.append(crv)

#h = rs.BoundingBox(travel[-1])[0].Z
#center_point = center_points[int(h)]
#points = rs.DivideCurve(travel[-1], 100)
#minimum = 100000
#translation = []
#for point in points:
#    dist = rs.Distance(point, center_point)
#    if dist < minimum:
#        minimum = dist
#        translation = point

#new_nozzle = rs.CopyObject(nozzle, translation=translation)
#print(center_point)
# ---------- end python_4 ----------
crv_3 = Curve(python_3.lines)
srf = Surface(python_3.print_bed)
crv_4 = Curve(python_3.connected_curve)
crv_5 = Curve(python_3.travel)
geo_3 = Geometry(python_4.new_nozzle)
crv_6 = Curve(python_4.travel)

join = JoinCurves(Curves=python_3.lines, Preserve=False)
divide = DivideCurve(Curve=join, Count=Slider(500, range=0..1000), Kinks=False)  # -> flatten(Points), Tangents, Parameters
dom = ConstructDomain(DomainStart=0, DomainEnd=Slider(0, range=0..15000))
panel = Panel(divide.Points)
subset = SubList(List=divide.Points, Domain=dom, Wrap=True)  # -> List, Index
intcrv_2 = Interpolate(Vertices=subset.List, Degree=3, Periodic=False, KnotStyle=1)  # -> Curve, Length, Domain
